# Grasshopper definition mesh wires.gh (Grasshopper 1.0.7)
# plug-ins: Kangaroo2 Components

# ---- group: RH_IN:radius
number_slider = Slider(30, range=10..30)

# ---- group: RH_IN:count
number_slider_2 = Slider(6, range=2..10)

# ---- group: RH_IN:step
number_slider_3 = Slider(2, range=0..5)

# ----
B = Base(PlaneXY(0, 0, 0))
msphere = MeshSphere(Base=B, Radius=number_slider, UCount=10, VCount=20)
popgeo = PopulateGeometry(Geometry=msphere, Count=number_slider_2, Seed=number_slider_3)
intcrv = Interpolate(Vertices=popgeo, Degree=3, Periodic=True, KnotStyle=1)  # -> Curve, Length, Domain
divide = DivideCurve(Curve=intcrv.Curve, Count=expr("x*2", number_slider_2), Kinks=False)  # -> Points, Tangents, Parameters
volume = Volume(Geometry=msphere)  # -> Volume, Centroid
ln = Line(StartPoint=divide.Points, EndPoint=volume.Centroid)
mp = MultiPipe(Curves=ln, NodeSize=expr("x-1", number_slider_3), EndOffset=1, StrutSize=1, Segment=0, KinkAngle=0.6, CubeFit=0)
meshsubd = MeshFromSubD(SubD=mp, Density=2)
demesh = DeconstructMesh(Mesh=mp)  # -> Vertices, Faces, Colours, Normals
mcol = MeshColours(Mesh=meshsubd, Colours=demesh.Normals)
medges = MeshEdges(Mesh=mcol)  # -> NakedEdges, InteriorEdges, NonManifoldEdges

# ---- group: RH_OUT:mesh
mesh = Mesh(mcol)

# ---- group: RH_OUT:edges
crv = Curve([intcrv.Curve, medges.InteriorEdges])
